# Grasshopper definition FlattestPath.gh (Grasshopper 0.8.62)

pointsofintrest = Point([<point referenced from the Rhino model> x7])
landscape = Surface(<surface referenced from the Rhino model>)

# ---- group: Create a Graph Connecting all POI
dist = Distance(PointA=graft(pointsofintrest), PointB=pointsofintrest)
bnd = Bounds(Numbers=flatten(dist))
domcomp = DomainComponents(Domain=bnd)  # -> Start, End
graphfrompoints = GraphFromPoints(GraphVertex=pointsofintrest, ConnectingDistance=domcomp.End)  # -> Graph, GraphDistances, ConnectionLines

# ---- group: Callculate Altitude Difference
line = Line(graft(graphfrompoints.ConnectionLines))
divlength = DivideLength(Curve=line, Length=Slider(2, range=2..10))  # -> Points, Tangents, Parameters
Z = UnitZ(Factor=1)
line_2 = LineSDL(Start=divlength.Points, Direction=Z, Length=1)
scx = SurfaceLine(Surface=landscape, Line=simplify(line_2), First=False)  # -> Curves, Points, UVPoints, Normal
path_mapper = PathMapper(scx.Points, source="{A;B}", target="{A}")
pcomp = Decompose(Point=path_mapper, Plane=PlaneXY(0, 0, 0))  # -> XComponent, YComponent, ZComponent
shift = ShiftList(List=pcomp.ZComponent, Shift=1, Wrap=True)
subtraction = Subtraction(A=pcomp.ZComponent, B=shift, DataComparison="shortest_list")
lng = ListLength(List=subtraction)
larger = LargerThan(FirstNumber=lng, SecondNumber=1)  # -> LargerThan, OrEqualTo
subtraction_2 = Subtraction(A=lng, B=1)
cull = CullPattern(List=subtraction_2, CullPattern=larger.LargerThan)
cull_i = CullIndex(List=subtraction, Indices=cull, Wrap=False)
abs = Absolute(Value=cull_i)
ma = MassAddition(Input=simplify(abs))  # -> Result, PartialResults
altitude_difference = Number(flatten(ma.Result))

# ---- group: replace GD (costs) for each GraphEdge
pointsofintrest_2 = Point(pointsofintrest)
end = EndPoints(Curve=graphfrompoints.ConnectionLines)  # -> Start, End
sort = SortList(Keys=simplify(graphfrompoints.Graph), ValuesGD=simplify(graphfrompoints.GraphDistances))  # -> Keys, ValuesGD
cp = ClosestPoint(Point=end.Start, Cloud=pointsofintrest_2)  # -> ClosestPoint, CPIndex, Distance
cp_2 = ClosestPoint(Point=end.End, Cloud=pointsofintrest_2)  # -> ClosestPoint, CPIndex, Distance
int = Integer(simplify(sort.Keys))
num = Number(simplify(sort.ValuesGD))
vb = VBScript(G=int, GD=num, FI=cp.CPIndex, TI=cp_2.CPIndex, values=altitude_difference)  # -> out, newGD; inputs G: tree, GD: tree, FI: list, TI: list, values: list
# ---------- vb: VB ----------
    'your code goes here…

    Dim indexFrom, indexTo, cursor As Integer

    For i As Integer = 0 To FI.Count - 1
      indexFrom = FI.item(i)
      indexTo = TI.item(i)

      cursor = G.Branch(indexFrom).BinarySearch(indexTo)
      GD.Branch(indexFrom).item(cursor) = values.item(i)


      cursor = G.Branch(indexTo).BinarySearch(indexFrom)
      GD.Branch(indexTo).item(cursor) = values.item(i)

    Next

    newGD = GD
# ---------- end vb ----------

# ---- group: create minimum Spanning Tree
pointsofintrest_3 = Point(pointsofintrest)
minst = MinST(Graph=sort.Keys, GraphDistance=vb.newGD)  # -> MininmalSpanningTree, GraphDistances
item = ListItem(List=flatten(pointsofintrest_3), Index=minst.MininmalSpanningTree, Wrap=False)
ln = Line(StartPoint=graft(pointsofintrest_3), EndPoint=item)
cleansetoflines = CleanSetOfLines(Lines=flatten(ln))

# ---- group: Average Altitude Difference
pointsofintrest_4 = Point(pointsofintrest)
landscape_2 = Surface(landscape)
Z_2 = UnitZ(Factor=1)
lng_2 = ListLength(List=pointsofintrest_4)
series = Series(Start=0, Step=1, Count=lng_2)
sp = ShortestPath(Graph=minst.MininmalSpanningTree, GraphDistances=minst.GraphDistances, StartPoints=series)  # -> Distance, ShortestPathGraph
line_3 = LineSDL(Start=pointsofintrest_4, Direction=Z_2, Length=1)
path_mapper_2 = PathMapper(sp.Distance, source="{A;B}", target="{B}")
scx_2 = SurfaceLine(Surface=landscape_2, Line=line_3, First=False)  # -> Curves, Points, UVPoints, Normal
avr = Average(Input=path_mapper_2)
cir = Circle(Plane=flatten(scx_2.Points), Radius=1)
num_2 = Number(flatten(avr))
srf = Surface(cir)
bnd_2 = Bounds(Numbers=num_2)
domcomp_2 = DomainComponents(Domain=bnd_2)  # -> Start, End
gradient = Gradient(
    LowerLimit=domcomp_2.Start,
    UpperLimit=domcomp_2.End,
    Parameter=num_2,
    stops=[0: None, 0: None, 0: None, 0: None, 0: None])
sort_2 = SortList(Keys=num_2, ValuesA=gradient)  # -> Keys, ValuesA
legend = Legend(Colour=sort_2.ValuesA, Tags=sort_2.Keys)
preview = CustomPreview(Geometry=srf, Shader=gradient)

# ---- group: Get Geodesic Lines
end_2 = EndPoints(Curve=flatten(cleansetoflines))  # -> Start, End
landscape_3 = Surface(landscape)
Z_3 = UnitZ(Factor=1)
line_4 = LineSDL(Start=end_2.Start, Direction=Z_3, Length=1)
line_5 = LineSDL(Start=end_2.End, Direction=Z_3, Length=1)
scx_3 = SurfaceLine(Surface=landscape_3, Line=line_4, First=False)  # -> Curves, Points, UVPoints, Normal
scx_4 = SurfaceLine(Surface=landscape_3, Line=line_5, First=False)  # -> Curves, Points, UVPoints, Normal
geodesic = Geodesic(Surface=landscape_3, Start=flatten(scx_3.Points), End=flatten(scx_4.Points))

# ---- group: POI
cset = CreateSet(List=flatten([scx_4.Points, scx_3.Points]))  # -> Set, Map
cir_2 = Circle(Plane=cset.Set, Radius=1)
