# Grasshopper definition GraphFromCells.gh (Grasshopper 0.8.66)

# ---- group: Input
# Information: This example demonstrates how to create a graph from a list of cells and the possible measurments that can be callculated with the help of the graph.
# 
# For more information please visit
# 
# www.gbl.tuwien.ac.at/Archiv/digital.html
# 
# or contact
# 
# richard.schaffranek@tuwien.ac.at
cells = Curve([<curve referenced from the Rhino model> x22])
entrance = Curve(<curve referenced from the Rhino model>)

# ---- group: Convert Cells to Graph
# SPIDER WEB
graphfromcells = GraphFromCells(Cells=cells)  # -> Graph, GraphDistances, GraphVertex, Lines

# ---- group: GRAPH Coloring
cells_2 = Curve(cells)
G = Integer(graphfromcells.Graph)
rndsgc = RandomizedSequentialGraphColoring(Graph=G, MaximumItterations=Slider(1000, range=0..1000), AimedColors=Slider(3, range=0..10))
item = ListItem(List=flatten(cells_2), Index=rndsgc, Wrap=False)
viewer = ParamViewer(rndsgc)
lng = ListLength(List=viewer)
series = Series(Start=0, Step=1, Count=lng)
gradient = Gradient(
    LowerLimit=0,
    UpperLimit=lng,
    Parameter=series,
    stops=[0: None, 0: None, 0: None, 0: None, 0: None, 0: None, 0: None, 0: None, 0: None, 0: None])
col = Colour(graft(gradient))
srf = Surface(item)
preview = CustomPreview(Geometry=srf, Shader=col)

# ---- group: Starting Points from where the Shortest Path is callculated
pcen = PolygonCenter(Polyline=entrance)  # -> CenterV, CenterE
lng_2 = ListLength(List=graphfromcells.GraphVertex)
cp = ClosestPoint(Point=pcen.CenterV, Cloud=graphfromcells.GraphVertex)  # -> ClosestPoint, CPIndex, Distance
series_2 = Series(Start=0, Step=1, Count=lng_2)
list = ValueList({"AllPoints": 0, "Entrance": 1}, selected=[], ListIndex=0, UIMode=1)
filter = StreamFilter(Gate=list, Stream0=series_2, Stream1=cp.CPIndex)
starting_points = Integer(filter)

# ---- group: Resynchronise Cell and GV Lists
pcen_2 = PolygonCenter(Polyline=cells)  # -> CenterV, CenterE
dist = Distance(PointA=graft(graphfromcells.GraphVertex), PointB=pcen_2.CenterV)
sort = SortList(Keys=dist, ValuesA=cells)  # -> Keys, ValuesA
item_2 = ListItem(List=sort.ValuesA, Index=0, Wrap=False)
crv = Curve(flatten(item_2))

# ---- group: ShortestPath Components
spa = ShortestPathAngular(Graph=graphfromcells.Graph, GraphVertex=graphfromcells.GraphVertex, StartPoints=starting_points)  # -> AngularDistance, ShortestPathGraph
dijk = Dijkstra(Graph=graphfromcells.Graph, GraphDistances=graphfromcells.GraphDistances, StartPoints=starting_points)  # -> Distance, DjikstraGraph

# ----
bfs = BreathFirstSearch(Graph=graphfromcells.Graph, StartPoints=starting_points)  # -> TraversalOrder, TraversalDepth

# ---- group: Average Distance from One Cell to All other Cells
num = Number(dijk.Distance)
srf_2 = Surface(crv)
path_mapper = PathMapper(num, source="{A;B}", target="{B}")
avr = Average(Input=path_mapper)
num_2 = Number(flatten(avr))
bnd = Bounds(Numbers=num_2)
domcomp = DomainComponents(Domain=bnd)  # -> Start, End
gradient_2 = Gradient(LowerLimit=domcomp.Start, UpperLimit=domcomp.End, Parameter=num_2, stops=[0: None, 0: None, 0: None, 0: None, 0: None])
concat = Concatenate(Start=num_2, End=" m")
sort_2 = SortList(Keys=num_2, ValuesA=gradient_2, ValuesB=concat)  # -> Keys, ValuesA, ValuesB
legend = Legend(Colour=sort_2.ValuesA, Tags=sort_2.ValuesB)
preview_2 = CustomPreview(Geometry=srf_2, Shader=gradient_2)

# ---- group: ChoiceBetweenPoints with a Maximum Detour
# Restriction: "ChoiceBetweenPoints" does only work reliable with euclidian distances > "ShortestPath"; It will produce no obvious comprehensible results when imput comes from the "ShortestPathAngular" component
max_detour = Slider(1.01, range=1..2)
choicebetweenpoints = ChoiceBetweenPoints(
    Graph=graphfromcells.Graph,
    Distance=dijk.Distance,
    GraphVertex=graphfromcells.GraphVertex,
    StartingPoints=starting_points,
    MaximalDetour=max_detour)  # -> ChoiceBetweenPoints, ConnectionLines
bnd_2 = Bounds(Numbers=choicebetweenpoints.ChoiceBetweenPoints)
domcomp_2 = DomainComponents(Domain=bnd_2)  # -> Start, End
gradient_3 = Gradient(
    LowerLimit=domcomp_2.Start,
    UpperLimit=domcomp_2.End,
    Parameter=choicebetweenpoints.ChoiceBetweenPoints,
    stops=[0: None, 0: None, 0: None, 0: None])
sort_3 = SortList(Keys=choicebetweenpoints.ChoiceBetweenPoints, ValuesA=gradient_3)  # -> Keys, ValuesA
int = Integer(sort_3.Keys)
legend_2 = Legend(Colour=sort_3.ValuesA, Tags=int)
preview_3 = CustomPreview(Geometry=choicebetweenpoints.ConnectionLines, Shader=gradient_3)

# ----
int_2 = Integer(bfs.TraversalDepth)
path_mapper_2 = PathMapper(int_2, source="{A;B}", target="{B}")
avr_2 = Average(Input=path_mapper_2)
num_3 = Number(flatten(avr_2))
bnd_3 = Bounds(Numbers=num_3)
domcomp_3 = DomainComponents(Domain=bnd_3)  # -> Start, End
gradient_4 = Gradient(
    LowerLimit=domcomp_3.Start,
    UpperLimit=domcomp_3.End,
    Parameter=num_3,
    stops=[0: None, 0: None, 0: None, 0: None, 0: None])
srf_3 = Surface(crv)
preview_4 = CustomPreview(Geometry=srf_3, Shader=gradient_4)

# ---- group: Average Angular Distance from One Cell to All other Cells
num_4 = Number(spa.AngularDistance)
srf_4 = Surface(crv)
path_mapper_3 = PathMapper(num_4, source="{A;B}", target="{B}")
avr_3 = Average(Input=path_mapper_3)
num_5 = Number(flatten(avr_3))
bnd_4 = Bounds(Numbers=num_5)
domcomp_4 = DomainComponents(Domain=bnd_4)  # -> Start, End
gradient_5 = Gradient(
    LowerLimit=domcomp_4.Start,
    UpperLimit=domcomp_4.End,
    Parameter=num_5,
    stops=[0: None, 0: None, 0: None, 0: None, 0: None])
concat_2 = Concatenate(Start=num_5, End=" °")
preview_5 = CustomPreview(Geometry=srf_4, Shader=gradient_5)

# ----
sort_4 = SortList(Keys=num_5, ValuesA=gradient_5, ValuesB=concat_2)  # -> Keys, ValuesA, ValuesB

# ---- group: Average Angular Distance from One Cell to All other Cells (continued)
legend_3 = Legend(Colour=sort_4.ValuesA, Tags=sort_4.ValuesB)
