# Grasshopper definition drainDiagramm.gh (Grasshopper 0.8.62)

# SPIDER WEB
# Information: This example demonstrates how to use spiderweb in order to show the drainaige area of a surface.
# 
# 
# For more information please visit
# 
# www.gbl.tuwien.ac.at/Archiv/digital.html
# 
# or contact
# 
# richard.schaffranek@tuwien.ac.at
panel = Panel("200")
landscape = Surface(<surface referenced from the Rhino model>)

# ---- group: callculate Connection Distance
dim = Dimensions(Surface=landscape)  # -> UDimension, VDimension
division = Division(A=dim.UDimension, B=panel)
division_2 = Division(A=dim.VDimension, B=panel)
max = Maximum(A=division, B=division_2)
sqrt = SquareRoot(Value=2)
multiplication = Multiplication(A=sqrt, B=max)

# ---- group: get meshpoints
mesh_uv = MeshSurface(Surface=landscape, UCount=panel, VCount=panel, Overhang=False, Equalize=False)
mcomp = Decompose(Mesh=mesh_uv)  # -> Vertices, Faces, Colours, Normals
pointsofintrest = Point(flatten(mcomp.Vertices))

# ---- group: create Path
pcomp = Decompose(Point=pointsofintrest, Plane=PlaneXY(0, 0, 0))  # -> XComponent, YComponent, ZComponent
pt = PointXYZ(XComponent=pcomp.XComponent, YComponent=pcomp.YComponent, ZComponent=0, Plane=PlaneXY(0, 0, 0))
graphfrompoints = GraphFromPoints(GraphVertex=pt, ConnectingDistance=multiplication)  # -> Graph, GraphDistances, ConnectionLines

# ---- group: only keep stepest graph edge
pcomp_2 = Decompose(Point=simplify(graft(pointsofintrest)), Plane=PlaneXY(0, 0, 0))  # -> XComponent, YComponent, ZComponent
item = ListItem(List=flatten(pointsofintrest), Index=graphfrompoints.Graph, Wrap=False)
pcomp_3 = Decompose(Point=item, Plane=PlaneXY(0, 0, 0))  # -> XComponent, YComponent, ZComponent
subtraction = Subtraction(A=pcomp_3.ZComponent, B=pcomp_2.ZComponent)
sort = SortList(Keys=simplify(subtraction), ValuesA=simplify(graphfrompoints.Graph))  # -> Keys, ValuesA
item_2 = ListItem(List=simplify(sort.ValuesA), Index=0, Wrap=False)
item_3 = ListItem(List=flatten(pointsofintrest), Index=item_2, Wrap=False)
ln = Line(StartPoint=graft(pointsofintrest), EndPoint=item_3)

# ---- group: recreate draining Graph
graphfromlines = GraphFromLines(ConnectionLines=flatten(ln))  # -> Graph, GraphDistances, GraphVertex
cset = CreateSet(List=graphfromlines.GraphDistances)  # -> Set, Map
cset_2 = CreateSet(List=graphfromlines.Graph)  # -> Set, Map

# ---- group: Get Low Points
item_4 = ListItem(List=simplify(sort.Keys), Index=0, Wrap=False)
larger = LargerThan(FirstNumber=item_4, SecondNumber=0)  # -> LargerThan, OrEqualTo
cull = CullPattern(List=pointsofintrest, CullPattern=flatten(larger.LargerThan))
cp = ClosestPoint(Point=cull, Cloud=graphfromlines.GraphVertex)  # -> ClosestPoint, CPIndex, Distance

# ---- group: color areas
sp = ShortestPath(Graph=cset_2.Set, GraphDistances=cset.Set, StartPoints=cp.CPIndex)  # -> Distance, ShortestPathGraph
item_5 = ListItem(List=sp.Distance, Index=0, Wrap=False)
lng = ListLength(List=cp.CPIndex)
path_mapper = PathMapper(item_5, source="{A;B}", target="{B}")
series = Series(Start=0, Step=1, Count=lng)
equals = Equality(FirstNumber=path_mapper, SecondNumber=-1)  # -> Equality, Inequality
num = Number(-1)
mesh = Mesh(mesh_uv)
mcomp_2 = Decompose(Mesh=mesh)  # -> Vertices, Faces, Colours, Normals
pt_2 = Point(graphfromlines.GraphVertex)
cp_2 = ClosestPoint(Point=mcomp_2.Vertices, Cloud=pt_2)  # -> ClosestPoint, CPIndex, Distance

# ----
mod = Modulus(A=series, B=6)

# ---- group: color areas (continued)
cull_2 = CullPattern(List=flatten(mod), CullPattern=equals.Inequality)
item_6 = ListItem(List=cull_2, Index=0, Wrap=False)
num_2 = Number(flatten(item_6))
lng_2 = ListLength(List=num_2)
null = NullItem(Item=num_2)  # -> NullFlags, InvalidFlags, Description
repeat = RepeatData(Data=num, Length=lng_2)
p_n_c = PickNChoose(Pattern=null.NullFlags, Stream0=num_2, Stream1=repeat)
bnd = Bounds(Numbers=p_n_c)
domcomp = DomainComponents(Domain=bnd)  # -> Start, End
gradient = Gradient(
    LowerLimit=domcomp.Start,
    UpperLimit=domcomp.End,
    Parameter=flatten(p_n_c),
    stops=[0: None, 0: None, 0: None, 0: None, 0: None])
item_7 = ListItem(List=gradient, Index=cp_2.CPIndex, Wrap=False)
mcol = MeshColours(Mesh=mesh, Colours=item_7)
