# Grasshopper definition longestLine.gh (Grasshopper 0.8.62)

slider = Slider(3, range=1..10)
pt = Point([<point referenced from the Rhino model> x2])

# ---- group: Creating Graph Edges
# SPIDER WEB
# Information: This example demonstrates how to create a graph from a list of lines and how to use Galapagos in order to callculate the longest path [Hamiltonian Path; http://en.wikipedia.org/wiki/Hamiltonian_path].
# 
# For more information please visit
# 
# www.gbl.tuwien.ac.at/Archiv/digital.html
# 
# or contact
# 
# richard.schaffranek@tuwien.ac.at
sqgrid = Square(Plane=PlaneXY(0, 0, 0), Size=1, ExtentX=slider, ExtentY=slider)  # -> Cells, Points
genes = GeneList(Minimum=0, Maximum=1, Decimals=0, Value=[0, 1, 1, 1, 0, 0, 0, 0, 1, 0, 0, 0, 1, 1, 0, 1, 1, 0, 0, 1, 0, 0, 0, 0])
explode = Explode(Curve=sqgrid.Cells, Recursive=True)  # -> Segments, Vertices
cleansetoflines = CleanSetOfLines(Lines=flatten(explode.Segments))
cull = CullPattern(List=cleansetoflines, CullPattern=genes)

# ----
lng = ListLength(List=cleansetoflines)
numberofgenes = Panel(lng)
graphfromlines = GraphFromLines(ConnectionLines=cull)  # -> Graph, GraphDistances, GraphVertex
cp = ClosestPoint(Point=pt, Cloud=graphfromlines.GraphVertex)  # -> ClosestPoint, CPIndex, Distance

# ---- group: ShortestPath Components
sp = ShortestPath(Graph=graphfromlines.Graph, GraphDistances=graphfromlines.GraphDistances, StartPoints=cp.CPIndex)  # -> Distance, ShortestPathGraph

# ----
item = ListItem(List=sp.Distance, Index=0, Wrap=False)

# ---- group: Fittnessfunktion Simple
path_mapper = PathMapper(item, source="{A;B}", target="{B}")
ma = MassAddition(Input=path_mapper)  # -> Result, PartialResults
item_2 = ListItem(List=flatten(ma.Result), Index=cp.CPIndex, Wrap=False)
avr = Average(Input=flatten(item_2))

# ----
cir = Circle(Plane=cp.ClosestPoint, Radius=0.3)
bbox = BoundingBox(Content=cleansetoflines, Union=True, Plane=PlaneXY(0, 0, 0))  # -> Box, Box_2
box_corners = BoxCorners(Box=bbox.Box)  # -> CornerA, CornerB, CornerC, CornerD, CornerE, CornerF, CornerG, CornerH
rec_2pt = Rectangle2Pt(Plane=PlaneXY(0, 0, 0), PointA=box_corners.CornerA, PointB=box_corners.CornerC, Radius=0)  # -> Rectangle, Length
fittnessfunktion = Number(avr)
rec = DataRecorder(fittnessfunktion, RecordData=False, DataLimit=-10)
galapagos = Galapagos(fitness=fittnessfunktion, gene=genes)
offset = Offset(Curve=rec_2pt.Rectangle, Distance=0.5, Plane=PlaneXY(0, 0, 0), Corners=1)
bnd = Bounds(Numbers=flatten(rec))
merge = Merge(Data1=flatten(cir), Data2=flatten(cull), Data3=flatten(offset))
domcomp = DomainComponents(Domain=bnd)  # -> Start, End
per_row = Slider(10, range=0..100)
offset_2 = Slider(5, range=0..100)
panel = Panel(fittnessfunktion)
larger = LargerThan(FirstNumber=fittnessfunktion, SecondNumber=domcomp.End)  # -> LargerThan, OrEqualTo
group = Group(Objects=merge)
rec_2 = DataRecorder(larger.OrEqualTo, RecordData=False, DataLimit=-10)
ma_2 = MassAddition(Input=rec_2)  # -> Result, PartialResult
division = Division(A=ma_2.Result, B=per_row)
panel_2 = Panel(larger.OrEqualTo)
mod = Modulus(A=ma_2.Result, B=per_row)
round = Round(Number=division)  # -> Nearest, Floor, Ceiling
subtraction = Subtraction(A=mod, B=1)
subtraction_2 = Subtraction(A=round.Floor, B=1)
multiplication = Multiplication(A=subtraction, B=offset_2)
multiplication_2 = Multiplication(A=subtraction_2, B=offset_2)
toggle = BooleanToggle(False)
vec = VectorXYZ(XComponent=multiplication, YComponent=multiplication_2, ZComponent=0)  # -> Vector, Length
move = Move(Geometry=group, Motion=vec.Vector)  # -> Geometry, Transform
bakeattributes = CSharpScript(objs=move.Geometry, layers="SimpleFittness", activate=larger.OrEqualTo)  # -> out; inputs objs: list, names: list of String, layers: list of String, colors: list of Color, pWidths: list of Double, wiresEach: list of Int32, materials: list, activate: Boolean, groupListTgthr: Boolean
# ---------- bakeattributes: C# ----------
    //Inserts geometry into the Rhino document, with custom attributes
    //Written by Giulio Piacentino
    //Version written 2011 10 18 - for Grasshopper 0.8.52

    if (activate)
    {
      int groupIndex = -1;
      if(groupListTgthr)
        groupIndex = doc.Groups.Add();

      for(int i = 0; i < objs.Count; i++)
      {
        object obj = objs[i];
        if(obj == null)
        {
          Print("No object to bake");
          return;
        }

        //Make new attribute to set name
        Rhino.DocObjects.ObjectAttributes att = new Rhino.DocObjects.ObjectAttributes();

        string name = names.Count > 0 ? names[i % names.Count] : null;
        //Set object name
        if(!string.IsNullOrEmpty(name))
        {
          att.Name = name;
        }

        Color color = colors.Count > 0 ? colors[i % colors.Count] : new Color();
        //Set color
        if(!color.IsEmpty)
        {
          att.ColorSource = Rhino.DocObjects.ObjectColorSource.ColorFromObject; //Make the color type "by object"
          att.ObjectColor = color;

          att.PlotColorSource = Rhino.DocObjects.ObjectPlotColorSource.PlotColorFromObject; //Make the plot color type "by object"
          att.PlotColor = color;
        }

        string layer = layers.Count > 0 ? layers[i % layers.Count] : null;
        //Set layer
        if(!string.IsNullOrEmpty(layer) && Rhino.DocObjects.Layer.IsValidName(layer))
        {
          //Get the current layer index
          Rhino.DocObjects.Tables.LayerTable layerTable = doc.Layers;
          int layerIndex = layerTable.Find(layer, true);

          if(layerIndex < 0) //This layer does not exist, we add it
          {
            Rhino.DocObjects.Layer onlayer = new Rhino.DocObjects.Layer(); //Make a new layer
            onlayer.Name = layer;

            layerIndex = layerTable.Add(onlayer); //Add the layer to the layer table
            if (layerIndex > -1) //We manged to add layer!
            {
              att.LayerIndex = layerIndex;
              Print("Added new layer to the document at position " + layerIndex + " named " + layer + ". ");
            } else
              Print("Layer did not add. Try cleaning up your layers."); //This never happened to me.
          }
          else
            att.LayerIndex = layerIndex; //We simply add to the existing layer
        }


        double pWidth = pWidths.Count > 0 ? pWidths[i % pWidths.Count] : 0;
        //Set plotweight
        if(pWidth > 0)
        {
          att.PlotWeightSource = Rhino.DocObjects.ObjectPlotWeightSource.PlotWeightFromObject;
          att.PlotWeight = pWidth;
        }


        object material = materials.Count > 0 ? materials[i % materials.Count] : null;
        //Set material
        bool materialByName = !string.IsNullOrEmpty(material as string);
        Rhino.Display.DisplayMaterial inMaterial = material as Rhino.Display.DisplayMaterial;
        if(material is Color)
        {
          inMaterial = new Rhino.Display.DisplayMaterial((Color) material);
        }
        if(material != null && inMaterial == null && !materialByName)
        {
          if(!(material is string))
          {
            try //We also resort to try with IConvertible
            {
              inMaterial = (Rhino.Display.DisplayMaterial) Convert.ChangeType(material, typeof(Rhino.Display.DisplayMaterial));
            }
            catch(InvalidCastException)
            {
            }
          }
        }
        if(inMaterial != null || materialByName)
        {
          string matName;

          if(!materialByName)
          {
            matName = string.Format("A:{0}-D:{1}-E:{2}-S:{3},{4}-T:{5}",
              Format(inMaterial.Ambient),
              Format(inMaterial.Diffuse),
              Format(inMaterial.Emission),
              Format(inMaterial.Specular),
              inMaterial.Shine.ToString(),
              inMaterial.Transparency.ToString()
              );
          }
          else
          {
            matName = (string) material;
          }

          int materialIndex = doc.Materials.Find(matName, true);
          if(materialIndex < 0 && !materialByName) //Material does not exist and we have its specs
          {
            materialIndex = doc.Materials.Add(); //Let's add it
            if(materialIndex > -1)
            {
              Print("Added new material at position " + materialIndex + " named \"" + matName + "\". ");
              Rhino.DocObjects.Material m = doc.Materials[materialIndex];
              m.Name = matName;
              m.AmbientColor = inMaterial.Ambient;
              m.DiffuseColor = inMaterial.Diffuse;
              m.EmissionColor = inMaterial.Emission;
              //m.ReflectionColor = no equivalent
              m.SpecularColor = inMaterial.Specular;
              m.Shine = inMaterial.Shine;
              m.Transparency = inMaterial.Transparency;
              //m.TransparentColor = no equivalent
              m.CommitChanges();

              att.MaterialSource = Rhino.DocObjects.ObjectMaterialSource.MaterialFromObject;
              att.MaterialIndex = materialIndex;
            }
            else
              Print("Material did not add. Try cleaning up your materials."); //This never happened to me.
          }
          else if(materialIndex < 0 && materialByName) //Material does not exist and we do not have its specs. We do nothing
          {
            Print("Warning: material name not found. I cannot set the source to this material name. Add a material with name: " + matName);
          }
          else
          {
            //If this material exists, we do not replace it!
            att.MaterialSource = Rhino.DocObjects.ObjectMaterialSource.MaterialFromObject;
            att.MaterialIndex = materialIndex;
          }
        }


        int wires = wiresEach.Count > 0 ? wiresEach[i % wiresEach.Count] : 0;
        //Set wire density
        if(wires == -1 || wires > 0)
        {
          att.WireDensity = wires;
        }

        Bake(obj, att, groupIndex);
      }
    }
    else
    {
      Print("Inactive");
    }
# ---------- bakeattributes: C# additional code ----------
  void Bake(object obj, Rhino.DocObjects.ObjectAttributes att, int groupIndex)
  {
    if(obj == null)
      return;

    Guid id;

    //Bake to the right type of object
    if(obj is GeometryBase)
    {
      GeometryBase geomObj = obj as GeometryBase;

      switch(geomObj.ObjectType)
      {
        case Rhino.DocObjects.ObjectType.Brep:
          id = doc.Objects.AddBrep(obj as Brep, att);
          break;
        case Rhino.DocObjects.ObjectType.Curve:
          id = doc.Objects.AddCurve(obj as Curve, att);
          break;
        case Rhino.DocObjects.ObjectType.Point:
          id = doc.Objects.AddPoint((obj as Rhino.Geometry.Point).Location, att);
          break;
        case Rhino.DocObjects.ObjectType.Surface:
          id = doc.Objects.AddSurface(obj as Surface, att);
          break;
        case Rhino.DocObjects.ObjectType.Mesh:
          id = doc.Objects.AddMesh(obj as Mesh, att);
          break;
        case (Rhino.DocObjects.ObjectType) 1073741824://Rhino.DocObjects.ObjectType.Extrusion:
          id = (Guid) typeof(Rhino.DocObjects.Tables.ObjectTable).InvokeMember("AddExtrusion", BindingFlags.Instance | BindingFlags.InvokeMethod, null, doc.Objects, new object[]{obj, att});
          break;
        case Rhino.DocObjects.ObjectType.PointSet:
          id = doc.Objects.AddPointCloud(obj as Rhino.Geometry.PointCloud, att); //This is a speculative entry
          break;
        default:
          Print("The script does not know how to handle this type of geometry: " + obj.GetType().FullName);
          return;
      }
    }
    else
    {
      Type objectType = obj.GetType();

      if(objectType == typeof(Arc))
      {
        id = doc.Objects.AddArc((Arc) obj, att);
      }
      else if(objectType == typeof(Box))
      {
        id = doc.Objects.AddBrep(((Box) obj).ToBrep(), att);
      }
      else if(objectType == typeof(Circle))
      {
        id = doc.Objects.AddCircle((Circle) obj, att);
      }
      else if(objectType == typeof(Ellipse))
      {
        id = doc.Objects.AddEllipse((Ellipse) obj, att);
      }
      else if(objectType == typeof(Polyline))
      {
        id = doc.Objects.AddPolyline((Polyline) obj, att);
      }
      else if(objectType == typeof(Sphere))
      {
        id = doc.Objects.AddSphere((Sphere) obj, att);
      }
      else if(objectType == typeof(Point3d))
      {
        id = doc.Objects.AddPoint((Point3d) obj, att);
      }
      else if(objectType == typeof(Line))
      {
        id = doc.Objects.AddLine((Line) obj, att);
      }
      else if(objectType == typeof(Vector3d))
      {
        Print("Impossible to bake vectors");
        return;
      }
      else if(obj is IEnumerable)
      {
        int newGroupIndex;
        if(groupIndex == -1)
          newGroupIndex = doc.Groups.Add();
        else
          newGroupIndex = groupIndex;
        foreach(object o in obj as IEnumerable)
        {
          Bake(o, att, newGroupIndex);
        }
        return;
      }
      else
      {
        Print("Unhandled type: " + objectType.FullName);
        return;
      }
    }

    if(groupIndex != -1)
    {
      doc.Groups.AddToGroup(groupIndex, id);
      Print("Added " + obj.GetType().Name + " to group number " + groupIndex);
    }
    else
      Print("Added " + obj.GetType().Name);
  }

  static string Format(Color c)
  {
    return (new System.Text.StringBuilder("A")).Append(c.A.ToString()).Append("R").Append(c.R.ToString()).Append("G")
      .Append(c.G.ToString()).Append("B").Append(c.B.ToString()).ToString();
  }
# ---------- end bakeattributes ----------

path_mapper_2 = PathMapper(item, source="{A;B}", target="{B}")  # disabled
lng_2 = ListLength(List=cull)  # disabled
ma_3 = MassAddition(Input=path_mapper_2)  # -> Result, PartialResults; disabled
item_3 = ListItem(List=flatten(ma_3.Result), Index=cp.CPIndex, Wrap=False)  # disabled
avr_2 = Average(Input=flatten(item_3))  # disabled

_2º = PowerOf2(Value=avr_2)  # disabled

multiplication_3 = Multiplication(A=_2º, B=lng_2)  # disabled
