# Grasshopper definition TT_Toolbox_Sample_release1.6.gh (Grasshopper 0.9.75)
# plug-ins: TT Toolbox
# TT Toolbox Sample File

# ----
# CurveType
crv = Curve([<curve referenced from the Rhino model> x4])  # disabled
panel = Panel(crv)  # disabled
ct = CurveType(Curve=crv)  # -> CurveType, IsPlanar, IsClosed; disabled
panel_2 = Panel(ct.CurveType)  # disabled
panel_3 = Panel(ct.IsPlanar)  # disabled
panel_4 = Panel(ct.IsClosed)  # disabled

# ----
# MatchTreeStructure
plane = PlaneSrf(Plane=PlaneXY(0, 0, 0), XSize=Domain(-10, 10), YSize=Domain(-10, 10))  # disabled
divide = DivideDomain²(Domain=plane, UCount=3, VCount=3)  # disabled
subsrf = Isotrim(Surface=plane, Domain=divide)  # disabled
pan = Panel("1")  # disabled
sdivide = DivideSurface(Surface=subsrf, UCount=pan, VCount=pan)  # -> Points, Normals, Parameters; disabled
lng = ListLength(List=flatten(sdivide.Points))  # disabled
viewer = ParamViewer(sdivide.Points)  # disabled
panel_5 = Panel(sdivide.Points)  # disabled
random = Random(Range=Domain(0, 1), Number=lng, Seed=2)  # disabled
viewer_2 = ParamViewer(random)  # disabled
panel_6 = Panel(random)  # disabled
match = MatchTreeStructure(DataList=flatten(random), TreeMask=sdivide.Points)  # disabled
panel_7 = Panel(match)  # disabled
viewer_3 = ParamViewer(match)  # disabled

# ----
# RemoveDuplicatePoints
list_of_pts = Panel("""1,0,0
1,5,0
1,10,0
1,10,0
1,15,0
1,0,0
1,5,0""")  # disabled
cullduppoints = RemoveDuplicatePoints(InputPoints=list_of_pts, Tolerance=0.001)  # -> OutputPoints, FirstPointIndexes; disabled
panel_8 = Panel(cullduppoints.OutputPoints)  # disabled
panel_9 = Panel(cullduppoints.FirstPointIndexes)  # disabled

# ----
# RemoveDuplicateLines
list_of_pts_a = Panel("""1,0,0
1,5,0
1,10,0
1,10,0
1,15,0
1,20,0
1,25,0""")  # disabled
list_of_pts_b = Panel("""10,0,0
10,5,0
10,10,0
10,10,0
10,15,0
10,20,0
10,25,0""")  # disabled
ln = Line(StartPoint=list_of_pts_a, EndPoint=list_of_pts_b)  # disabled
cullduplines = RemoveDuplicateLines(InputLines=ln, Tolerance=0.001)  # -> OutputLines, FirstLineIndexes; disabled
panel_10 = Panel(cullduplines.FirstLineIndexes)  # disabled
panel_11 = Panel(cullduplines.OutputLines)  # disabled

# ----
# TTSweep
# A) Right Click Component to set Inputs
# B) Set Shape(s) by list of strings and rotation by Planes
crv_2 = Curve([<curve referenced from the Rhino model> x3])  # disabled
degrees = Slider(90, range=0..180)  # disabled
crv_3 = Curve(<curve referenced from the Rhino model>)  # disabled
plane_rotation = Slider(115, range=0..360)  # disabled
panel_12 = Panel("-1")  # disabled
panel_13 = Panel("1")  # disabled
curvepoint = PointOnCurve(crv_2, parameter=0)  # disabled
X = UnitX(Factor=panel_12)  # disabled
Z = UnitZ(Factor=panel_13)  # disabled
# copyright: Thornton Tomasetti, Inc.
# Date: 07/10/2014
# Revision: 000
# GH: 0.9.0075
# Description: For Release 1.6
# The following to samples demonstrate the functionality of the tools
# in TT Toolbox.
panel_14 = Panel("""Mesh? 
Set True""")  # disabled
pl = Plane(Origin=curvepoint, XAxis=X, YAxis=Z)  # disabled
rad = Radians(Degrees=plane_rotation)  # disabled
ttsweep = TTSweep(
    OutputMesh=False,
    BeamRail=crv_3,
    Justification=-1,
    Rotation=degrees,
    JustificationIndex=4,
    SectionNameIndex=191,
    ShapeTypeIndex=0,
    UnitTypeIndex=0)  # -> BrepsOrMeshes, SectionProfiles; disabled
prot = RotatePlane(Plane=pl, Angle=rad)  # disabled
section_rotation = Slider(0, range=0..360)  # disabled
justification = Slider(4, range=0..8)  # disabled
ttsweepnames = TTSweepNames(outputListLength=0, String=["W14X90", "2L8X8X5/8", "HSS20X8X5/8"])  # disabled
panel_15 = Panel(ttsweep.BrepsOrMeshes)  # disabled
panel_16 = Panel(ttsweepnames)  # disabled
ttsweep_2 = TTSweep(
    OutputMesh=False,
    BeamRail=crv_2,
    SectionNameOrCurve=ttsweepnames,
    Justification=justification,
    Rotation=section_rotation,
    SweepPlane=prot,
    JustificationIndex=4,
    SectionNameIndex=191,
    ShapeTypeIndex=0,
    UnitTypeIndex=0)  # -> BrepsOrMeshes, SectionProfiles; disabled
crv_4 = Curve(ttsweep_2.SectionProfiles)  # disabled
brep = Brep(ttsweep_2.BrepsOrMeshes)  # disabled

# ----
# SortCurvesAlongCurves
# Original
# Sorted
crv_5 = Curve([<curve referenced from the Rhino model> x6])  # disabled
crv_6 = Curve(<curve referenced from the Rhino model>)  # disabled
slider = Slider(0, range=0..1)  # disabled
eval = EvaluateCurve(Curve=reparameterize(crv_5), Parameter=0.5)  # -> Point, Tangent, Angle; disabled
sortc = SortCurvesAlongCrv(Curves=crv_5, GuideCrv=crv_6, CrvParam=slider)  # -> SortedCurves, CurveIndex; disabled
slider_2 = Slider(2, range=0..10)  # disabled
eval_2 = EvaluateCurve(Curve=sortc.SortedCurves, Parameter=0.5)  # -> Point, Tangent, Angle; disabled
panel_17 = Panel(sortc.CurveIndex)  # disabled
points = PointList(Points=eval.Point, Tags=True, Lines=True, Size=expr("x/2", slider_2))  # disabled
points_2 = PointList(Points=eval_2.Point, Tags=True, Lines=True, Size=slider_2)  # disabled

# ----
# TreeBranch
# Specify an integer, not an actual branch
# path to select a branch.
cell_size = Slider(3, range=0..10)  # disabled
cells = Slider(3, range=0..10)  # disabled
height = Slider(50, range=0..100)  # disabled
levels = Slider(8, range=0..10)  # disabled
pt = ConstructPoint(XCoordinate=0, YCoordinate=0, ZCoordinate=0)  # disabled
Z_2 = UnitZ(Factor=1)  # disabled
sqgrid = Square(Plane=PlaneXY(0, 0, 0), Size=cell_size, ExtentX=cells, ExtentY=cells)  # -> Cells, flatten(Points); disabled
line = LineSDL(Start=pt, Direction=Z_2, Length=height)  # disabled
divide_2 = DivideCurve(Curve=line, Number=levels, Kinks=False)  # -> Points, Tangents, Parameters; disabled
xy = XYPlane(Origin=divide_2.Points)  # disabled
project = Project(Geometry=sqgrid.Points, Plane=graft(xy))  # -> Geometry, Transform; disabled
slider_3 = Slider(4, range=0..10)  # disabled
swatch = ColourSwatch(SwatchColor=RGB(255, 255, 255))  # disabled
panel_18 = Panel(project.Geometry)  # disabled
viewer_4 = ParamViewer(project.Geometry)  # disabled
tbi = TreeBranchIndex(DataTree=project.Geometry, BranchIndex=slider_3)  # disabled
preview = CustomPreview(Geometry=tbi, Shader=swatch)  # disabled
panel_19 = Panel(tbi)  # disabled
viewer_5 = ParamViewer(tbi)  # disabled

# ----
# TreeItem
# Specify an integer, not an actual branch
# path to select a branch and item.
cell_size_2 = Slider(3, range=0..10)  # disabled
height_2 = Slider(50, range=0..100)  # disabled
levels_2 = Slider(8, range=0..10)  # disabled
cells_2 = Slider(3, range=0..10)  # disabled
pt_2 = ConstructPoint(XCoordinate=0, YCoordinate=0, ZCoordinate=0)  # disabled
Z_3 = UnitZ(Factor=1)  # disabled
sqgrid_2 = Square(Plane=PlaneXY(0, 0, 0), Size=cell_size_2, ExtentX=cells_2, ExtentY=cells_2)  # -> Cells, flatten(Points); disabled
line_2 = LineSDL(Start=pt_2, Direction=Z_3, Length=height_2)  # disabled
divide_3 = DivideCurve(Curve=line_2, Number=levels_2, Kinks=False)  # -> Points, Tangents, Parameters; disabled
xy_2 = XYPlane(Origin=divide_3.Points)  # disabled
project_2 = Project(Geometry=sqgrid_2.Points, Plane=graft(xy_2))  # -> Geometry, Transform; disabled
branch = Slider(3, range=0..10)  # disabled
item = Slider(10, range=0..25)  # disabled
viewer_6 = ParamViewer(project_2.Geometry)  # disabled
panel_20 = Panel(project_2.Geometry)  # disabled
swatch_2 = ColourSwatch(SwatchColor=RGB(255, 255, 255))  # disabled
tii = TreeItemIndex(DataTree=project_2.Geometry, BranchIndex=branch, ItemIndex=item)  # disabled
preview_2 = CustomPreview(Geometry=tii, Shader=swatch_2)  # disabled
viewer_7 = ParamViewer(tii)  # disabled
panel_21 = Panel(tii)  # disabled

# ----
# CAD Exporter
# Choose a location to save files
cell_size_3 = Slider(3, range=0..10)  # disabled
cells_3 = Slider(3, range=0..10)  # disabled
height_3 = Slider(50, range=0..100)  # disabled
levels_3 = Slider(8, range=0..10)  # disabled
pt_3 = ConstructPoint(XCoordinate=0, YCoordinate=0, ZCoordinate=0)
Z_4 = UnitZ(Factor=1)  # disabled
sqgrid_3 = Square(Plane=PlaneXY(0, 0, 0), Size=cell_size_3, ExtentX=cells_3, ExtentY=cells_3)  # -> Cells, flatten(Points); disabled
line_3 = LineSDL(Start=pt_3, Direction=Z_4, Length=height_3)  # disabled
divide_4 = DivideCurve(Curve=line_3, Number=levels_3, Kinks=False)  # -> Points, Tangents, Parameters; disabled
xy_3 = XYPlane(Origin=divide_4.Points)  # disabled
project_3 = Project(Geometry=sqgrid_3.Points, Plane=graft(xy_3))  # -> Geometry, Transform; disabled
pdecon = Deconstruct(Point=project_3.Geometry)  # -> XComponent, YComponent, ZComponent; disabled
bnd = Bounds(Numbers=flatten(pdecon.ZComponent))  # disabled
dom = Domain(DomainStart=1, DomainEnd=0.4)  # disabled
remap = RemapNumbers(Value=pdecon.ZComponent, Source=bnd, Target=dom)  # -> Mapped, Clipped; disabled
circle = CircleCNR(Center=project_3.Geometry, Normal=Vector(0, 0, 1), Radius=remap.Mapped)  # disabled
panel_22 = Panel("""floor1
floor2
floor3
floor4
floor5""")  # disabled
area = Area(Geometry=circle)  # -> Area, Centroid; disabled
panel_23 = Panel("C:\...")  # disabled
str = String(simplify(graft(panel_22)))  # disabled
panel_24 = Panel("""layer1
layer2
layer3
layer4
layer5""")  # disabled
toggle = BooleanToggle(False)  # disabled
panel_25 = Panel("dxf")  # disabled
panel_26 = Panel(".02")  # disabled
cadexporter = CADExporter(
    Export=toggle,
    ExportType=panel_25,
    FilePaths=panel_23,
    FileNames=str,
    LayerNames=panel_24,
    Points=area.Centroid,
    Curves=circle,
    TextLocations=area.Centroid,
    Texts=area.Area,
    TextSizes=panel_26)  # disabled

# ----
# UnitConverter
slider_4 = Slider(1, range=0..1)  # disabled
slider_5 = Slider(1, range=0..6)  # disabled
panel_27 = Panel("mm")  # disabled
panel_28 = Panel("in")  # disabled
uc = UnitConverter(TargetUnit=panel_27, SourceUnit=panel_28, Factor=slider_4, Exponent=slider_5)  # -> RHUnit, Value; disabled
panel_29 = Panel(uc.RHUnit)  # disabled
panel_30 = Panel(uc.Value)  # disabled

# ---- group: X&Y inputs : GENOMES
slider_6 = Slider(0.429, range=0..1)  # disabled
slider_7 = Slider(0.331, range=0..1)  # disabled

# ---- group: Rhino Surface
srf = Surface(reparameterize(<surface referenced from the Rhino model>))  # disabled

# ----
# B) Points Specified
panel_31 = Panel("20")  # disabled
pop3d = Populate3D(Region={Plane=PlaneXY(0, 0, 0), X=Domain(0, 10), Y=Domain(0, 10), Z=Domain(0, 2)}, Count=panel_31, Seed=1)  # disabled
panel_32 = Panel("""1
1
0""")  # disabled
cull = CullPattern(List=pop3d, CullPattern=panel_32)  # disabled
con = DelaunayEdges(Points=cull, Plane=PlaneXY(0, 0, 0))  # -> Connectivity, Edges; disabled
crv_7 = Curve(con.Edges)  # disabled
pt_4 = Point(cull)  # disabled
branch_2 = Slider(0, range=0..15)  # disabled
nodeconn = SharedNodes(Curves=flatten(crv_7), Points=flatten(pt_4))  # -> GroupedCurves, CommonPoints; disabled
tbi_2 = TreeBranchIndex(DataTree=nodeconn.GroupedCurves, BranchIndex=branch_2)  # disabled
tbi_3 = TreeBranchIndex(DataTree=nodeconn.CommonPoints, BranchIndex=branch_2)  # disabled
swatch_3 = ColourSwatch(SwatchColor=RGB(8, 253, 255))  # disabled
preview_3 = CustomPreview(Geometry=[tbi_2, tbi_3], Shader=swatch_3)  # disabled

# ---- group: Points
number_slider = Slider(5, range=1..10)  # disabled
number_slider_2 = Slider(3, range=1..10)  # disabled
number_slider_3 = Slider(4, range=0..10)  # disabled
number_slider_4 = Slider(5, range=1..10)  # disabled
number_slider_5 = Slider(0, range=0..10)  # disabled
number_slider_6 = Slider(6, range=1..10)  # disabled
number_slider_7 = Slider(4, range=1..10)  # disabled
number_slider_8 = Slider(3, range=1..10)  # disabled
number_slider_9 = Slider(0, range=0..10)  # disabled
panel_33 = Panel("-1")  # disabled
panel_34 = Panel("-1")  # disabled
panel_35 = Panel("-1")  # disabled
multiplication = Multiplication(A=number_slider_2, B=panel_35)  # disabled
multiplication_2 = Multiplication(A=number_slider_6, B=panel_34)  # disabled
multiplication_3 = Multiplication(A=number_slider_7, B=panel_33)  # disabled
pt_5 = ConstructPoint(XCoordinate=number_slider, YCoordinate=multiplication, ZCoordinate=number_slider_3)  # disabled
pt_6 = ConstructPoint(XCoordinate=number_slider_4, YCoordinate=multiplication_2, ZCoordinate=number_slider_5)  # disabled
pt_7 = ConstructPoint(XCoordinate=number_slider_8, YCoordinate=multiplication_3, ZCoordinate=number_slider_9)  # disabled

# ----
# SharedNodes
# A) No Points Specified
panel_36 = Panel("20")  # disabled
pop3d_2 = Populate3D(Region={Plane=PlaneXY(0, 0, 0), X=Domain(0, 10), Y=Domain(0, 10), Z=Domain(0, 2)}, Count=panel_36, Seed=1)  # disabled
con_2 = DelaunayEdges(Points=pop3d_2, Plane=PlaneXY(0, 0, 0))  # -> Connectivity, Edges; disabled
crv_8 = Curve(con_2.Edges)  # disabled
branch_3 = Slider(4, range=0..15)  # disabled
nodeconn_2 = SharedNodes(Curves=flatten(crv_8))  # -> GroupedCurves, CommonPoints; disabled
tb = TreeBranch(DataTree=nodeconn_2.GroupedCurves, BranchIndex=branch_3)  # disabled
tb_2 = TreeBranch(DataTree=nodeconn_2.CommonPoints, BranchIndex=branch_3)  # disabled
swatch_4 = ColourSwatch(SwatchColor=RGB(8, 253, 255))  # disabled
preview_4 = CustomPreview(Geometry=[tb, tb_2], Shader=swatch_4)  # disabled

# ---- group: Variables_Genomes
variabletwo = Slider(11, range=11..15)  # disabled
variableone = Slider(1, range=1..10)  # disabled

# ---- group: Brep
number_slider_10 = Slider(5.19, range=0..10)  # disabled
rec = Rectangle({Plane=PlaneXZ(4, 0, 0), Size=Domain2(u=0..2, v=0..1)})  # disabled
boxrec = BoxRectangle(Rectangle=rec, Height=number_slider_10)  # disabled

# ---- group: Fitness Function
multiplication_4 = Multiplication(A=variableone, B=variabletwo)  # disabled

# ----
# BRUTE FORCE
button = Button()  # disabled
toggle_2 = BooleanToggle(False)  # disabled
galaplist = GalapagosListener(Genomes=[variableone, variabletwo], Fitness=multiplication_4, Reset=toggle_2)  # -> Fitness, Iterations; disabled
data_tree_of_fitness = Panel(galaplist.Fitness)  # disabled
data_tree_of_iterations = Panel(galaplist.Iterations)  # disabled

bt = BruteForce(NumberSlider=[variableone, variabletwo], RunTheScript=button, SetLimit=1000)  # disabled

# ---- group: Plane
xz = XZPlane(Origin=Point(0, 0, 0))  # disabled

# ----
# TTExcel Tools
# 1) Write to Excel - simple
columns = Slider(8, range=1..40)  # disabled
rows = Slider(6, range=1..40)  # disabled
repeat = RepeatData(Data=columns, Length=rows)  # disabled
lng_2 = ListLength(List=repeat)  # disabled
panel_37 = Panel(" 0")  # disabled
random_2 = Random(Range=Domain(0, 1), Number=lng_2, Seed=2)  # disabled
dom_2 = Domain(DomainStart=panel_37, DomainEnd=lng_2)  # disabled
random_3 = Random(Range=Domain(0, 1), Number=repeat, Seed=random_2)  # disabled
random_4 = Random(Range=dom_2, Number=1, Seed=graft(random_2))  # disabled
replace = ListReplace(List=random_3, Indices=random_4, Wrap=False)  # disabled
columns_rows = BooleanToggle(True)  # disabled
write = BooleanToggle(False)  # disabled
str_2 = String(simplify(replace))  # disabled
writexl = WriteToExcel(Run=write, ExcelWorksheet="1", WriteOptions="None", ColumnnsOrRows=columns_rows, DataToWriteIntoColumns=str_2)  # disabled

# ----
# 2) Write to Excel - complete
rows_2 = Slider(22, range=1..40)  # disabled
columns_2 = Slider(3, range=1..40)  # disabled
repeat_2 = RepeatData(Data=rows_2, Length=columns_2)  # disabled
series = Series(Start=1, Step=1, Count=columns_2)  # disabled
series_2 = Series(Start=1, Step=1, Count=rows_2)  # disabled
panel_38 = Panel("COL_")  # disabled
panel_39 = Panel("ROW_")  # disabled
int = Integer(series)  # disabled
int_2 = Integer(series_2)  # disabled
lng_3 = ListLength(List=repeat_2)  # disabled
concat = Concatenate(A=panel_38, B=int)  # disabled
concat_2 = Concatenate(A=panel_39, B=int_2)  # disabled
column_start = Slider(1, range=1..40)  # disabled
row_start = Slider(1, range=1..40)  # disabled
random_5 = Random(Range=Domain(0, 1), Number=lng_3, Seed=2)  # disabled
random_6 = Random(Range=Domain(0, 1), Number=repeat_2, Seed=random_5)  # disabled
wo = WriteOptions(
    ClearDataOverwrite=True,
    SaveAfterWrite=False,
    CloseAfterWrite=False,
    ColumnStartPosition=column_start,
    RowStartPosition=row_start)  # -> UserMessages, WriteOptions; disabled
str_3 = String(simplify(random_6))  # disabled
write_2 = BooleanToggle(False)  # disabled
writexl_2 = WriteToExcel(
    Run=write_2,
    ExcelWorksheet="1",
    ColumnNames=concat,
    RowNames=concat_2,
    WriteOptions=wo.WriteOptions,
    ColumnnsOrRows=False,
    DataToWriteIntoColumns=str_3)  # disabled

# ----
# DASHBOARD
# Gradient Legend
number_slider_11 = Slider(7, range=3..20)  # disabled
series_3 = Series(Start=0, Step=1, Count=number_slider_11)  # disabled
bnd_2 = Bounds(Numbers=series_3)  # disabled
dedomain = DeconstructDomain(Domain=bnd_2)  # -> Start, End; disabled
gradient = Gradient(
    LowerLimit=dedomain.Start,
    UpperLimit=dedomain.End,
    Parameter=series_3,
    stops=[0: RGB(0, 98, 0), 0.25: RGB(81, 175, 17), 0.5: RGB(159, 198, 146), 0.75: RGB(170, 235, 41), 1: RGB(221, 255, 53)])  # disabled
panel_40 = Panel("Sample Gradient Legend")  # disabled
panel_41 = Panel("Draw a Gradient Legend that floats on top of RH/GH")  # disabled
number_slider_12 = Slider(3, range=3..10)  # disabled

# ----
# Stepped Legend
number_slider_13 = Slider(7, range=3..20)  # disabled
series_4 = Series(Start=0, Step=1, Count=number_slider_13)  # disabled
bnd_3 = Bounds(Numbers=series_4)  # disabled
panel_42 = Panel(series_4)  # disabled
dedomain_2 = DeconstructDomain(Domain=bnd_3)  # -> Start, End; disabled
gradient_2 = Gradient(
    LowerLimit=dedomain_2.Start,
    UpperLimit=dedomain_2.End,
    Parameter=series_4,
    stops=[0: RGB(0, 128, 0), 0.5: RGB(255, 255, 0), 1: RGB(255, 0, 0)])  # disabled
panel_43 = Panel("Sample Stepped Legend")  # disabled
panel_44 = Panel("Draw a Stepped Legend that floats on top of RH/GH")  # disabled

# ----
# Graph
number_slider_14 = Slider(7, range=3..20)  # disabled
series_5 = Series(Start=1, Step=1, Count=number_slider_14)  # -> reverse(Series); disabled
bnd_4 = Bounds(Numbers=series_5)  # disabled
int_3 = Integer(series_5)  # disabled
panel_45 = Panel("Value ")  # disabled
concat_3 = Concatenate(FragmentA=panel_45, FragmentB=int_3)  # disabled
dedomain_3 = DeconstructDomain(Domain=bnd_4)  # -> Start, End; disabled
gradient_3 = Gradient(
    LowerLimit=dedomain_3.Start,
    UpperLimit=dedomain_3.End,
    Parameter=series_5,
    stops=[0: RGB(255, 0, 0), 0.1: RGB(236, 27, 60), 0.2: RGB(210, 0, 118), 0.3: RGB(103, 0, 120), 0.4: RGB(39, 72, 161), 0.5: RGB(1, 192, 229), 0.6: RGB(18, 178, 90), 0.7: RGB(79, 186, 8), 0.8: RGB(220, 237, 32), 0.9: RGB(247, 159, 20), 1: RGB(243, 57, 0)])  # disabled
number_slider_15 = Slider(1, range=1..5)  # disabled
panel_46 = Panel("Sample Dashboard Graph")  # disabled
panel_47 = Panel("Draw a graph to visualize live data in Grasshopper.")  # disabled

# ----
# Soccer Players
number_slider_16 = Slider(10, range=1..100)
players = SoccerPlayers(Connect=Toggle(False), Limit=number_slider_16)  # -> JSON, FirstName, LastName, TeamId, ClubId, FilteredAttributes
filtered_attributes = Panel(players.FilteredAttributes)
club_id = Panel(players.ClubId)
json_array = Panel(players.JSON)
first_name = Panel(players.FirstName)
last_name = Panel(players.LastName)
team_id = Panel(players.TeamId)

# ----
# Soccer Teams
number_slider_17 = Slider(5, range=1..100)
teams = SoccerTeams(Connect=Toggle(False), Limit=number_slider_17)  # -> JSON, Name, Id, FilteredAttributes
filtered_attributes_2 = Panel(teams.FilteredAttributes)
name_of_soccer_teams = Panel(teams.Name)
team_ids = Panel(teams.Id)
json_array_2 = Panel(teams.JSON)

# ----
# Soccer Clubs
number_slider_18 = Slider(5, range=1..100)
# WORLD CUP 2014
toggle_3 = BooleanToggle(False)
clubs = SoccerClubs(Connect=toggle_3, Limit=number_slider_18)  # -> JSON, Name, Country, ClubID, FilteredAttributes
filtered_attributes_3 = Panel(clubs.FilteredAttributes)
json_array_3 = Panel(clubs.JSON)
name_of_soccer_clubs = Panel(clubs.Name)
club_id_2 = Panel(clubs.ClubID)
country = Panel(clubs.Country)

# ----
# Text display
# and Text Options
panel_48 = Panel("""Architectural
Structural
Mechanical""")  # disabled
panel_49 = Panel(""" 
 
 """)  # disabled
panel_50 = Panel("Sample Dashboard Text Display")  # disabled
panel_51 = Panel("Visualize Colored Text Values.")  # disabled
number_slider_19 = Slider(18, range=8..20)  # disabled
number_slider_20 = Slider(16, range=8..20)  # disabled
number_slider_21 = Slider(8, range=8..20)  # disabled
swatch_5 = ColourSwatch(SwatchColor=RGB(0, 0, 255))  # disabled
swatch_6 = ColourSwatch(SwatchColor=RGB(255, 0, 255))  # disabled
swatch_7 = ColourSwatch(SwatchColor=RGB(255, 126, 0))  # disabled
swatch_8 = ColourSwatch(SwatchColor=RGB(129, 129, 125))  # disabled
text_options = TextOptions(
    TextColour=swatch_8,
    TextSize_Title=number_slider_19,
    TextSizeOfLabels=number_slider_20,
    TextSizeOfDescription=number_slider_21)  # disabled

gradient_colour_legend = GradientColourLegend(Gradient=gradient, Start=dedomain.Start, End=dedomain.End, Step=number_slider_12, Title=panel_40, Description=panel_41)  # disabled
stepped_colour_legend = SteppedColourLegend(Colours=gradient_2, Start=dedomain_2.Start, End=dedomain_2.End, Title=panel_43, Description=panel_44)  # disabled
graph = Graph(Colours=gradient_3, Labels=concat_3, Values=int_3, GraphType=number_slider_15, Title=panel_46, Description=panel_47)  # disabled
label_value_display = LabelValueDisplay(
    Colours=[swatch_6, swatch_7, swatch_5],
    Label=panel_48,
    Values=panel_49,
    Title=panel_50,
    Description=panel_51,
    TextOptions=text_options)  # disabled

# ----
# GetGeometryAttributes
crv_9 = Curve([<curve referenced from the Rhino model> x4])  # disabled

geoattrib = GetGeometryAttributes(Geometry=crv_9)  # -> GeometryNames, GUID, Layer; disabled

panel_52 = Panel(geoattrib.GeometryNames)  # disabled
panel_53 = Panel(geoattrib.GUID)  # disabled
panel_54 = Panel(geoattrib.Layer)  # disabled

# ----
# GALAPAGOS LISTENER
# Run Galapagos, Collect iterations, Write to Excel
# Read Iterations from Excel and Visualize
toggle_4 = BooleanToggle(False)  # disabled
readxl = ReadExcelSheet(Run=toggle_4, Worksheet="1")  # -> UserMessages, Columns, Rows; disabled
pt_8 = ConstructPoint(XCoordinate=slider_7, YCoordinate=slider_6, ZCoordinate=0)  # disabled
panel_55 = Panel("1")  # disabled
panel_56 = Panel("2")  # disabled
panel_57 = Panel("0")  # disabled
eval_3 = EvaluateSurface(Surface=srf, Point=pt_8)  # -> Point, Normal, Frame; disabled
merge = Merge(Data1=slider_7, Data2=slider_6)  # disabled
pt_9 = Point(eval_3.Point)  # disabled
reset = BooleanToggle(False)  # disabled
pdecon_2 = Deconstruct(Point=pt_9)  # -> XComponent, YComponent, ZComponent; disabled
galapagos = Galapagos(fitness=pdecon_2, gene=[slider_7, slider_6])
toggle_5 = BooleanToggle(False)  # disabled
wo_2 = WriteOptions(ClearDataOverwrite=False, SaveAfterWrite=False, CloseAfterWrite=False, ColumnStartPosition=1, RowStartPosition=1)  # -> UserMessages, WriteOptions; disabled

item_2 = ListItem(List=readxl.Rows, Index=panel_57, Wrap=True)  # disabled
item_3 = ListItem(List=readxl.Rows, Index=panel_56, Wrap=True)  # disabled
item_4 = ListItem(List=readxl.Rows, Index=panel_55, Wrap=True)  # disabled
pt_10 = ConstructPoint(XCoordinate=item_4, YCoordinate=item_3, ZCoordinate=0)  # disabled
galaplist_2 = GalapagosListener(Genomes=merge, Fitness=pdecon_2.ZComponent, Reset=reset)  # -> Fitness, Iterations; disabled

# ---- group: FITNESS
num = Number(pdecon_2.ZComponent)  # disabled
panel_58 = Panel(num)  # disabled

# ----
merge_2 = Merge(Data1=galaplist_2.Fitness, Data2=galaplist_2.Iterations)  # disabled

bnd_5 = Bounds(Numbers=flatten(item_2))  # disabled
gradient_4 = Gradient(LowerLimit=0, UpperLimit=bnd_5, Parameter=item_2, stops=[0: RGB(0, 128, 0), 0.5: RGB(255, 255, 0), 1: RGB(255, 0, 0)])  # disabled
eval_4 = EvaluateSurface(Surface=srf, Point=pt_10)  # -> Point, Normal, Frame; disabled
datatree_of_iterations = Panel(merge_2)  # disabled
preview_5 = CustomPreview(Geometry=eval_4.Point, Shader=gradient_4)  # disabled
writexl_3 = WriteToExcel(
    Run=toggle_5,
    ExcelWorksheet="1",
    WriteOptions=wo_2.WriteOptions,
    ColumnnsOrRows=True,
    DataToWriteIntoColumns=datatree_of_iterations)  # disabled

# ---- group: Curve on Brep
crv_10 = Curve(<curve referenced from the Rhino model>)  # disabled

# ----
# Unfold
brep_2 = Brep(boxrec)  # disabled

# ---- group: Curve on Brep (continued)
project_4 = Project(Curve=crv_10, Brep=brep_2, Direction=Vector(0, 0, 1))  # disabled

# ---- group: Points on Brep
brep_cp = BrepClosestPoint(Point=[pt_5, pt_6, pt_7], Brep=brep_2)  # -> Point, Distance; disabled

# ----
unfold = Unfold(Brep=brep_2, Points=brep_cp.Point, Curves=project_4, Plane=xz)  # -> UnFold, Pts, Curves; disabled
unfold_surfaces = Panel(unfold.UnFold)  # disabled
curves_unfolded_w_brep = Panel(unfold.Curves)  # disabled
points_unfolded_w_brep = Panel(unfold.Pts)  # disabled

# ----
# 4) Listen from Excel
# Read points from an excel doc, and stitch together a mesh mesh using the points.  Color by Z value.
read_data = BooleanToggle(False)  # disabled
listen_for_changes = BooleanToggle(False)  # disabled
readxl_2 = ReadExcelSheet(Run=read_data, Worksheet="1", Listen=listen_for_changes)  # -> UserMessages, Columns, Rows; disabled

# ---- group: Generate mesh
bang = ExplodeTree(Data=readxl_2.Columns)  # -> Branch0, Branch1, Branch2; disabled
pt_11 = PointXYZ(XComponent=bang.Branch0, YComponent=bang.Branch1, ZComponent=bang.Branch2, System=PlaneXY(0, 0, 0))  # disabled
del = DelaunayMesh(Points=pt_11, Plane=PlaneXY(0, 0, 0))  # disabled
mesh = Mesh(del)  # disabled

# ---- group: Color Mesh by Z
mcomp = Decompose(Mesh=mesh)  # -> Vertices, Faces, Colours, Normals; disabled
pcomp = Decompose(Point=mcomp.Vertices, System=PlaneXY(0, 0, 0))  # -> XComponent, YComponent, ZComponent; disabled
bnd_6 = Bounds(Numbers=pcomp.ZComponent)  # disabled
domcomp = DomainComponents(Domain=bnd_6)  # -> Start, End; disabled
gradient_5 = Gradient(
    LowerLimit=domcomp.Start,
    UpperLimit=domcomp.End,
    Parameter=pcomp.ZComponent,
    stops=[0: RGB(0, 255, 255), 1: RGB(255, 0, 255)])  # disabled

# ----
mcol = MeshColours(Mesh=mesh, Colours=gradient_5)  # disabled

# ----
# 3) Read from Excel
worksheet_number = Slider(1, range=1..3)  # disabled
read = BooleanToggle(False)  # disabled

readxl_3 = ReadExcelSheet(Run=read, Worksheet=worksheet_number, Listen=False)  # -> UserMessages, Columns, Rows; disabled

viewer_8 = ParamViewer(readxl_3.Columns)  # disabled
data_as_columns = Panel(readxl_3.Columns)  # disabled
data_as_rows = Panel(readxl_3.Rows)  # disabled
viewer_9 = ParamViewer(readxl_3.Rows)  # disabled
